# Grasshopper definition DDU_Clay3DPrinting_Simulator.gh (Grasshopper 1.0.8)

# ----
# LEGEND
comments_notes = Panel("USER INTERACTION")
comments_notes_2 = Panel("GEOMETRY PROCESSING")
# EXPERIMENTAL SLICER SETUP FOR CLAY PRINTING: Authors: Max Benjamin Eschenbach, Mirko Dutschke
# 
# Digital Design Unit (DDU)
# Prof. Dr.-Ing. Oliver Tessmann
# Fachbereich Architektur
# Technical University of Darmstadt
# 
# 
# CREDITS:
# ------------
# ORIGINAL GCODE GENERATOR SCRIPT BY TOM SVILANS
# ADAPTED BY MAX BENJAMIN ESCHENBACH
# 
# ORIGINAL HEAT METHOD SCRIPT BY DANIEL PIKER
# ADAPTED FOR NONPLANAR SLICING BY MAX BENJAMIN ESCHENBACH
# 
# ORIGINAL "DefinitionDependencies" COMPONENT BY ANDERS HOLDEN DELEURAN, ADAPTED BY MAX BENJAMIN ESCHENBACH
# 
# ORIGINAL VCF COMPONENT BY ANDERS HOLDEN DELEURAN
# ADAPTED BY MAX BENJAMIN ESCHENBACH
# 
# "MeshPipeChromo" COMPONENT FOR FAST MESH PIPING
# BY CAMERON NEWNHAM, COPYRIGHT 2015-2016
# LICENSED UNDER GNU GPL
# 
# SOME XYLINUS CLUSTERS BY RYAN HOOVER ARE BEING USED
# BY Independent Studio  |  MICA dFab  |  BUGSS
comments_notes_3 = Panel("VISUALISATION")
comments_notes_4 = Panel("OUTPUT")
comments_notes_5 = Panel("ANALYSIS")
comments_notes_6 = Panel("CONTROL FLOW")
comments_notes_7 = Panel("ADVANCED FEATURE")
# DEPENDENCIES: DEPENDENCIES:
# 
# - Clipper2GH Components
#   https://www.food4rhino.com/en/app/clipper2gh
comments_notes_8 = Panel("DO NOT TOUCH")

panel = Panel("\"C:\\Users\\EFESTWIN\\OneDrive\\PRINT_Architecture\\04_GCODE\\230609\\Vase.gcode\"")

file_input = Data(panel)
panel_2 = Panel("...")
python = GhPythonScript(s=file_input)  # -> p
# ---------- python: Python ----------
__author__ = "EFESTWIN"
__version__ = "2023.06.27"

import rhinoscriptsyntax as rs

if s.startswith('"'):
    s = s[1:]
if s.endswith('"'):
    s = s[:-1]
p = s
# ---------- end python ----------
file_input_2 = FilePath(python)

wasp_40100_printing_diameter = Slider(400, range=0..1000)
wasp40100_arm_length = Slider(350, range=0..1500)
layer_height = Slider(1.9, range=0..10)
visprintingprogress = Slider(100, range=0..100)
line_width = Slider(4, range=0..10)
printingsimulation = BooleanToggle(False)
showprinter = BooleanToggle(True)

wasp_40100_printing_diameter_2 = Data(wasp_40100_printing_diameter)
printingsimulation_2 = Data(printingsimulation)
xy = XYPlane(Origin=Point(0, 0, 0))
Y = UnitY(Factor=expr("(x-10)*0.5", wasp_40100_printing_diameter_2))
move = Move(Geometry=xy, Motion=Y)  # -> Geometry, Transform
cir = Circle(Plane=xy, Radius=expr("x*0.5", wasp_40100_printing_diameter_2))
crv_cp = CurveClosestPoint(Point=move.Geometry, Curve=reparameterize(cir))  # -> Point, Parameter, Distance
seam = Seam(Curve=reparameterize(cir), Seam=crv_cp.Parameter)
filter = StreamFilter(Gate=printingsimulation_2, Stream1=seam)
boundary = BoundarySurfaces(Edges=seam)
wasp40100_printing_area_srf = Data(boundary)
wasp40100_printing_area_crv = Data(filter)

wasp40100_printing_area_crv_2 = Data(wasp40100_printing_area_crv)
divide = DivideCurve(Curve=wasp40100_printing_area_crv_2, Count="3", Kinks=False)  # -> Points, Tangents, Parameters
Z = UnitZ(Factor=1)
line = LineSDL(Start=divide.Points, Direction=Z, Length=Slider(1000, range=0..1000))
wasp40100_z_axis_crvs = Data(line)

wasp40100_printing_area_srf_2 = Data(wasp40100_printing_area_srf)
showprinter_2 = Data(showprinter)
filter_2 = StreamFilter(Gate=showprinter_2, Stream1=wasp40100_printing_area_srf_2)
preview = CustomPreview(Geometry=filter_2, Material=ColourSwatch(SwatchColor=RGB(227, 227, 227)))

comments_notes_9 = Panel("PRINTER SIM & VISUALISATION")

gcode_input = Data(file_input_2)

gcode_input_2 = Data(gcode_input)
comments_notes_10 = Panel("GCODE VISUALISATION")
division = Division(A=visprintingprogress, B="100")
retractioncolor = ColourSwatch(SwatchColor=RGB(68, 194, 0))
extrusioncolor = ColourSwatch(SwatchColor=RGB(255, 94, 0))
travelcolor = ColourSwatch(SwatchColor=RGB(0, 85, 255))
printingsimulation_3 = Data(printingsimulation)

file = ReadFile(File=gcode_input_2, PerLineParse=True)

gcode = Data(file)
parsegcode = CSharpScript(GCODE=gcode)  # -> out, G, X, Y, Z, E, F; inputs GCODE: list of String
# ---------- parsegcode: C# usings ----------
using System.Text.RegularExpressions;
# ---------- parsegcode: C# ----------
    List<string> _G = new List<string>();
    List<double> _X = new List<double>();
    List<double> _Y = new List<double>();
    List<double> _Z = new List<double>();
    List<double> _E = new List<double>();
    List<double> _F = new List<double>();

    double Ztemp = 0.0;
    double Etemp = 0.0;
    double Ftemp = 0.0;

    Regex re_colon_a = new Regex(" ;");
    Regex re_colon_b = new Regex(" |;");

    var cult = System.Globalization.CultureInfo.InvariantCulture;

    for (int i = 0; i < GCODE.Count; i++)
    {
      string ln = GCODE[i];

      if (ln.StartsWith(";"))
      {
        continue;
      }
      else if (ln.StartsWith("G0") || ln.StartsWith("G1"))
      {
        if (ln.Contains("X") && ln.Contains("Y"))
        {
          _G.Add(ln.Substring(1, 1));
        }
        else
        {
          continue;
        }

        string[] preparts = re_colon_a.Split(ln);
        string[] parts = re_colon_b.Split(preparts[0]);
  
        // loop over all string parts
        for (int j = 0; j < parts.Length; j++)
        {
          string part = parts[j];
  
          // catch X values
          if (part.StartsWith("X")) _X.Add(double.Parse(part.Substring(1), cult));
  
          // catch Y values
          if (part.StartsWith("Y")) _Y.Add(double.Parse(part.Substring(1), cult));
  
          // catch Z values
          if (part.StartsWith("Z"))
          {
            double Zval = double.Parse(part.Substring(1), cult);
            _Z.Add(Zval);
            Ztemp = Zval;
          }
  
          // catch E values
          if (part.StartsWith("E"))
          {
            double Eval = double.Parse(part.Substring(1), cult);
            _E.Add(Eval);
            Etemp = Eval;
          }
  
          // catch F values
          if (part.StartsWith("F"))
          {
            double Fval = double.Parse(part.Substring(1), cult);
            _F.Add(Fval);
            Ftemp = Fval;
          }
        }
        // catch missing Z values
        if (ln.Contains("X") && ln.Contains("Y") && !ln.Contains("Z")) _Z.Add(Ztemp);
  
        // catch missing E values
        if (!ln.Contains("E")) _E.Add(Etemp);
  
        // catch missing F values
        if (!ln.Contains("F")) _F.Add(Ftemp);
      }
      else
      {
        Print(ln);
      }
    }
  
    G = _G;
    X = _X;
    Y = _Y;
    Z = _Z;
    E = _E;
    F = _F;
# ---------- end parsegcode ----------
item = ListItem(List=parsegcode.Z, Index=0, Wrap=True)  # -> Item, Item1, Item2, Item3
first_layer_z_coord = Panel(item.Item3)
pt = ConstructPoint(XCoordinate=parsegcode.X, YCoordinate=parsegcode.Y, ZCoordinate=parsegcode.Z)
lng = ListLength(List=pt)
dom = ConstructDomain(DomainStart="0", DomainEnd=lng)
remap = RemapNumbers(Value=division, Source=Domain(0, 1), Target=dom)  # -> Mapped, Clipped
round = Round(Number=remap.Mapped)  # -> Nearest, Floor, Ceiling
split = SplitList(List=pt, Index=round.Nearest)  # -> ListA, ListB
split_2 = SplitList(List=parsegcode.E, Index=round.Nearest)  # -> ListA, ListB
classifymovements = CSharpScript(
    Points=split.ListA,
    E=split_2.ListA,
    ExtrusionColor=extrusioncolor,
    TravelColor=travelcolor,
    RetractionColor=retractioncolor)  # -> out, L, C, PL, PPL; inputs Points: list of Point3d, E: list of Double, ExtrusionColor: Color, TravelColor: Color, RetractionColor: Color
# ---------- classifymovements: C# ----------
    List<LineCurve> Lines = new List<LineCurve>();
    List<LineCurve> PrintLines = new List<LineCurve>();
    List<System.Drawing.Color> Colors = new List<System.Drawing.Color>();
    List<Polyline> PrintPolyLines = new List<Polyline>();

    Polyline pl_temp = new Polyline();

    for (int i = 0; i < Points.Count - 1; i++)
    {
      // construct line curve
      LineCurve ln = new LineCurve(Points[i], Points[i + 1]);
      Lines.Add(ln);

      // set flags
      bool travel = E[i + 1] == 0 || E[i] == E[i + 1];
      bool retract = E[i + 1] < E[i];
      bool approach = E[i] == 0 && E[i + 1] > 0;

      // evaluate flags
      if (travel || approach)
      {
        Colors.Add(TravelColor);
        // finish print polyline if it has at least two vertices
        if (pl_temp.Count > 1)
        {
          PrintPolyLines.Add(pl_temp.Duplicate());
          pl_temp = new Polyline();
        }
      }
      else if (retract)
      {
        Colors.Add(RetractionColor);
        // finish print polyline if it has at least two vertices
        if (pl_temp.Count > 1)
        {
          PrintPolyLines.Add(pl_temp.Duplicate());
          pl_temp = new Polyline();
        }
      }
      else
      {
        Colors.Add(ExtrusionColor);
        PrintLines.Add(ln);
        // add points to print polyline
        if (pl_temp.Count == 0)
        {
          // add A point if this is the start of the PPL
          pl_temp.Add(Points[i]);
        }
        // always add B point
        pl_temp.Add(Points[i + 1]);
      }
      
      // catch unfinished PPL and finalize it
      if (pl_temp.Count > 0 && i == Points.Count - 2)
      {
        PrintPolyLines.Add(pl_temp.Duplicate());
        pl_temp = new Polyline();
      }

      L = Lines;
      C = Colors;
      PL = PrintLines;
      PPL = PrintPolyLines;
    }
# ---------- end classifymovements ----------
item_2 = ListItem(List=split.ListA, Index=0, Wrap=True)  # -> Item1, Item
printpolylines = Data(classifymovements.PPL)
movelines = Data(classifymovements.L)
printlines = Data(classifymovements.PL)
gcode_last_pt = Data(item_2.Item1)
filter_3 = StreamFilter(Gate=printingsimulation_3, Stream0=movelines)
cpl = CustomPreviewLineweights(Geometry=filter_3, Color=classifymovements.C, Thickness=Slider(3, range=0..10))  # inputs Geometry: list, Color: list of Color
# ---------- cpl: Python ----------
"""
Custom Preview with Lineweights.
    Inputs:
        Geometry: The geometry to preview. {list, GeometryBase}
        Color: The preview color per geometry item. {list, System.Drawing.Color}
        Thickness: The thickness of the wire display. {item, int}
    Remarks:
        Author: Max Eschenbach
        License: MIT License
        Version: 231122
"""

# PYTHON STANDARD LIBRARY IMPORTS
from __future__ import division, print_function
import json
import math

# GHPYTHON SDK IMPORTS
from ghpythonlib.componentbase import executingcomponent as component
import Grasshopper, GhPython
import System
import Rhino
import rhinoscriptsyntax as rs

# GHENV COMPONENT SETTINGS
ghenv.Component.Name = "CustomPreviewLineweights"
ghenv.Component.NickName = "CPL"
ghenv.Component.Category = "FindersKeepers"
ghenv.Component.SubCategory = "4 Visualisation"

class CustomPreviewLineweights(component):
    
    def __init__(self):
        super(CustomPreviewLineweights, self).__init__()
        
        self.draw_lines = System.Collections.Generic.List[Rhino.Geometry.Line]()
        self.draw_curves = []
        self.draw_color = []
        self.draw_thickness = None
    
    
    def RunScript(self, Geometry, Color, Thickness):
        
        self.draw_lines = System.Collections.Generic.List[Rhino.Geometry.Line]()
        self.draw_curves = []
        self.draw_color = None
        self.draw_thickness = None
        
        if not Color:
            self.draw_color = [System.Drawing.Color.Black]
        else:
            self.draw_color = Color
        
        if not Thickness:
            self.draw_thickness = 1
        else:
            self.draw_thickness = Thickness
        
        if Geometry:
            for i, geo in enumerate(Geometry):
                if isinstance(geo, Rhino.Geometry.Line):
                    self.draw_curves.Add(Rhino.Geometry.LineCurve(geo))
                elif isinstance(geo, Rhino.Geometry.Curve):
                    self.draw_curves.append(geo)
                elif isinstance(geo, Rhino.Geometry.LineCurve):
                    self.draw_curves.Add(geo)
                elif isinstance(geo, Rhino.Geometry.Rectangle3d):
                    self.draw_curves.append(geo.ToNurbsCurve())
                else:
                    print(type(geo))
    
    
    def get_ClippingBox(self):
        return Rhino.Geometry.BoundingBox()
    
    
    def DrawViewportWires(self, arg):
        try:
            for i, crv in enumerate(self.draw_curves):
                if i >= len(self.draw_color):
                    col = self.draw_color[-1]
                else:
                    col = self.draw_color[i]
                if not col:
                    rml = self.RuntimeMessageLevel.Remark
                    self.AddRuntimeMessage(rml, 'Expected Color, got NoneType! '
                                                 'Substituting with Black...')
                    col = System.Drawing.Color.Black
                arg.Display.DrawCurve(crv, col, self.draw_thickness)
        except Exception, e:
            rml = self.RuntimeMessageLevel.Warning
            self.AddRuntimeMessage(rml, 'Error while drawing Preview!')
            # System.Windows.Forms.MessageBox.Show(
            #                     str(e),
            #                     'Error while drawing preview!')
# ---------- end cpl ----------

# ----
# PRINTING TIME APPROXIMATION
panel_3 = Panel("3000")
movelines_2 = Data(movelines)
print_speed_mm_min = Data(panel_3)
len = Length(Curve=movelines_2)
addition_factor = Slider(1.45, range=0..2)
ma = MassAddition(Input=len)  # -> Result, PartialResults
division_2 = Division(A=ma.Result, B=print_speed_mm_min)
multiplication = Multiplication(A=division_2, B=addition_factor)
comments_notes_11 = Panel("PRINTING TIME APPROXIMATION")
rtd = RoundToDecimal(Numbers=multiplication, DecimalPlaces="2")  # -> Rounded; inputs Numbers: list, DecimalPlaces: list of Int32
# ---------- rtd: Python ----------
"""
Rounds input numbers to a decimal place.
    Inputs:
        Numbers: The numbers to round. {list, float}
        DecimalPlaces: Number of decimal places for the generated random
                       numbers. Set to 0 for integer numbers.
                       Defaults to 2.
                       {list, int}
    Output:
        Rounded: The number rounded to DecimalPlaces.
                 {list/tree, float/int}
    Remarks:
        Author: Max Eschenbach
        License: MIT License
        Version: 230103
"""

# PYTHON STANDARD LIBRARY IMPORTS
from __future__ import division, print_function

# GHPYTHONLIB SDK IMPORTS
from ghpythonlib.componentbase import executingcomponent as component
import Grasshopper, GhPython
import System
import Rhino

# GHENV COMPONENT SETTINGS
ghenv.Component.Name = "RoundToDecimal"
ghenv.Component.NickName = "RTD"
ghenv.Component.Category = "FindersKeepers"
ghenv.Component.SubCategory = "5 Math"

class RoundToDecimal(component):
    
    def RunScript(self, Numbers, DecimalPlaces):
        
        if not DecimalPlaces:
                DecimalPlaces = [0]
        
        if Numbers:
            rounded = []
            for i, num in enumerate(Numbers):
                # retrieve decimalplaces
                if i < len(DecimalPlaces):
                    dp = DecimalPlaces[i]
                else:
                    dp = DecimalPlaces[-1]
                # round number
                rounded.append(round(num, dp))
        else:
            rounded = Grasshopper.DataTree[object]()
        
        # return outputs if you have them; here I try it for you:
        return rounded
# ---------- end rtd ----------
division_3 = Division(A=rtd, B="60")
approximate_printing_time_in_minutes = Panel(rtd)
round_2 = Round(Number=division_3)  # -> Nearest, Floor, Ceiling
panel_4 = Panel("[INFO] Approximate Printing Time is {0} hours, {1} minutes, {2} seconds.")
subtraction = Subtraction(A=division_3, B=round_2.Floor)
multiplication_2 = Multiplication(A=subtraction, B="60")
round_3 = Round(Number=multiplication_2)  # -> Nearest, Floor, Ceiling
subtraction_2 = Subtraction(A=multiplication_2, B=round_3.Floor)
multiplication_3 = Multiplication(A=subtraction_2, B="60")
approximate_print_time = Data(rtd)
round_4 = Round(Number=multiplication_3)  # -> Nearest, Floor, Ceiling
format = Format(Format=panel_4, Culture=127, Data0=round_2.Floor, Data1=round_3.Floor, Data2=round_4.Floor)
info_approximate_print_time = Data(format)
approximate_printing_time_in_minutes_2 = Panel(info_approximate_print_time)

# ----
# MATERIAL AMOUNT CALCULATION
# TESTED WEIGHT PARAMETERS: Intersecting Wall 937g
# Mirko Schlaufen 383g
# Vase 541g
printing_curves = Geometry(printlines)
linewidth = Data(line_width)
layer_height_2 = Number(layer_height)
filletfactor = Slider(0.3, range=0..1)
dom_2 = ConstructDomain(DomainStart=expr("x*-0.5", linewidth), DomainEnd=expr("x*0.5", linewidth))
dom_3 = ConstructDomain(DomainStart=expr("x*-0.5", layer_height_2), DomainEnd=expr("x*0.5", layer_height_2))
min = Minimum(A=linewidth, B=layer_height_2)
len_2 = Length(Curve=printing_curves)  # -> flatten(Length)
multiplication_4 = Multiplication(A=min, B=filletfactor)
ma_2 = MassAddition(Input=len_2)  # -> Result, PartialResults
rectangle = Rectangle(Plane=PlaneXY(0, 0, 0), XSize=dom_2, YSize=dom_3, Radius=multiplication_4)  # -> Rectangle, Length
area = Area(Geometry=rectangle.Rectangle)  # -> Area, Centroid
printing_curves_length_mm = Data(ma_2.Result)
print_profile_area_mm2 = Data(area.Area)
comments_notes_12 = Panel("MATERIAL AMOUNT CALCULATION")
multiplication_5 = Multiplication(A=printing_curves_length_mm, B=print_profile_area_mm2)
multiplication_6 = Multiplication(A=multiplication_5, B="0.001")
specific_weight_clay_in_g_cm3 = Panel("1.99")
addpercentage = Slider(20, range=0..100)
print_volume_mm3 = Data(multiplication_5)
print_volume_cm3 = Data(multiplication_6)
multiplication_7 = Multiplication(A=print_volume_cm3, B=specific_weight_clay_in_g_cm3)
num = Number(expr("x*0.01", addpercentage))
multiplication_8 = Multiplication(A=multiplication_7, B=num)
addition = Addition(A=multiplication_7, B=multiplication_8)
rtd_2 = RoundToDecimal(Numbers=addition, DecimalPlaces="2")  # -> Rounded; inputs Numbers: list, DecimalPlaces: list of Int32; same code as rtd
print_weight_in_g = Panel(rtd_2)
format_2 = Format(Format="[INFO] Approximate Material Weight is {0} g.", Culture=127, Data0=rtd_2)
info_approximate_print_weight = Data(format_2)
approximate_print_weight = Data(rtd_2)

print_weight_in_g_2 = Panel(info_approximate_print_weight)

# ----
# comments & notes: PRINTING SIM & MESH VISUALISATION OF GCODE PATHS
printingsimulation_4 = Data(printingsimulation)
printpolylines_2 = Data(printpolylines)
filter_4 = StreamFilter(Gate=printingsimulation_4, Stream1=printpolylines_2)
divlength = DivideLength(Curve=filter_4, Length=Slider(500, range=0..1000))  # -> Points, Tangents, Parameters
numsegments = Slider(10, range=0..10)
shatter = Shatter(Curve=graft(filter_4), Parameters=divlength.Parameters)  # -> flatten(Segments)
linewidth_2 = Data(line_width)
multiplication_9 = Multiplication(A=linewidth_2, B="0.5")
meshpipechromo = CSharpScript(P=shatter, N=numsegments, R=multiplication_9, C=Toggle(False))  # -> M; inputs P: list of Curve, N: Int32, R: Double, C: Boolean
# ---------- meshpipechromo: C# usings ----------
using System.Linq;
# ---------- meshpipechromo: C# ----------
    ﻿/*
     *      ___  _  _  ____   __   _  _   __  ____   __  ____  __  ____
     *     / __)/ )( \(  _ \ /  \ ( \/ ) /  \(    \ /  \(  _ \(  )/ ___)
     *    ( (__ ) __ ( )   /(  O )/ \/ \(  O )) D ((  O ))   / )( \___ \
     *     \___)\_)(_/(__\_) \__/ \_)(_/ \__/(____/ \__/(__\_)(__)(____/
     *
     *    Copyright Cameron Newnham 2015-2016
     *
     *    This program is free software: you can redistribute it and/or modify
     *    it under the terms of the GNU General Public License as published by
     *    the Free Software Foundation, either version 3 of the License, or
     *    (at your option) any later version.
     *
     *    This program is distributed in the hope that it will be useful,
     *    but WITHOUT ANY WARRANTY; without even the implied warranty of
     *    MERCHANTABILITY or FITNESS FOR A PARTICULAR PURPOSE.  See the
     *    GNU General Public License for more details.
     *
     *    You should have received a copy of the GNU General Public License
     *    along with this program.  If not, see <http://www.gnu.org/licenses/>.
     *
     */

    List<Polyline> pls = new List<Polyline>();

    foreach (var c in P)
    {
      Polyline p;
      if (c.TryGetPolyline(out p)) {
        pls.Add(p);
      }
      else
      {
        this.Component.AddRuntimeMessage(GH_RuntimeMessageLevel.Error, "Input must be polylines.");
        return;
      }
    }
    Mesh _M = GetPiped(pls, N, R, C);
    _M.UnifyNormals();
    M = new GH_Mesh(_M);
# ---------- meshpipechromo: C# additional code ----------
  public Mesh GetPiped(List<Polyline> polylines, int numSides, double radius, bool cap)
  {
    var pt = new Point3d(radius, 0, 0);
    Polyline polygon = new Polyline();

    Point3d curr = new Point3d(pt);
    polygon.Add(curr);
    var xfm = Transform.Rotation(Math.PI * 2 / (double) numSides, Point3d.Origin);
    for (int i = 0; i < numSides; i++)
    {
      var pNew = new Point3d(curr);
      pNew.Transform(xfm);

      polygon.Add(pNew);
      curr = pNew;
    }

    var multimesh = new Mesh[polylines.Count];

    System.Threading.Tasks.Parallel.For(0, polylines.Count, pc => {
      Polyline pl = polylines[pc];
      List<Plane> frames = new List<Plane>();
      for (int i = 0; i < pl.Count; i++)
      {
        Point3d o = pl[i];
        Vector3d dir = Vector3d.Unset;
        if (i == 0)
        {
          if (!pl.IsClosed)
          {
            dir = pl[1] - pl[0];
            dir.Unitize();
          }
          else
          {
            Vector3d prevDir = pl[0] - pl[pl.Count - 2];
            Vector3d nextDir = pl[1] - pl[0];
            prevDir.Unitize();
            nextDir.Unitize();
            dir = (prevDir + nextDir) / 2;
            dir.Unitize();
          }
        }
        else if (i == pl.Count - 1)
        {
          if (!pl.IsClosed)
          {
            dir = pl[pl.Count - 1] - pl[pl.Count - 2];
            dir.Unitize();
          }
        }
        else
        {
          Vector3d prevDir = pl[i] - pl[i - 1];
          Vector3d nextDir = pl[i + 1] - pl[i];
          prevDir.Unitize();
          nextDir.Unitize();
          dir = (prevDir + nextDir) / 2;
          dir.Unitize();
        }

        if (frames.Count > 0)
        {
          if (dir != Vector3d.Unset)
          {
            var prevFrame = frames.Last();
            var newPlane = new Plane(o, dir);
            double rotAng = Vector3d.VectorAngle(prevFrame.XAxis, newPlane.XAxis, newPlane);
            newPlane.Rotate(-rotAng, newPlane.ZAxis);
            frames.Add(newPlane);
          }
        }
        else
        {
          frames.Add(new Plane(o, dir));
        }
      }

      Mesh mesh = new Mesh();
      Mesh capm = null;
      var poly = new Polyline(polygon);
      poly.Transform(Transform.PlaneToPlane(Plane.WorldXY, frames.First()));

      int[] lastVerts = new int[numSides];
      for (int p = 0; p < poly.Count - 1; p++)
      {
        lastVerts[p] = mesh.Vertices.Add(poly[p]);
      }

      int[] firstVerts = lastVerts;

      if (cap && !pl.IsClosed)
      {
        capm = Mesh.CreateFromClosedPolyline(poly);
      }

      for (int i = 1; i < frames.Count; i++)
      {
        poly = new Polyline(polygon);
        poly.Transform(Transform.PlaneToPlane(Plane.WorldXY, frames[i]));

        int[] newVerts = new int[numSides];
        for (int p = 0; p < poly.Count - 1; p++)
        {
          newVerts[p] = mesh.Vertices.Add(poly[p]);
        }

        for (int v = 1; v <= numSides; v++)
        {

          if (v == numSides)
          {
            mesh.Faces.AddFace(lastVerts[v - 1], lastVerts[0], newVerts[0], newVerts[v - 1]);
          }
          else
          {
            mesh.Faces.AddFace(lastVerts[v - 1], lastVerts[v], newVerts[v], newVerts[v - 1]);

          }
        }

        lastVerts = newVerts;
      }

      if (pl.IsClosed)
      {

        // resolve any twists
        for (int v = 1; v <= numSides; v++)
        {
          if (v == numSides)
          {
            mesh.Faces.AddFace(lastVerts[v - 1], lastVerts[0], firstVerts[0], firstVerts[v - 1]);
          }
          else
          {
            mesh.Faces.AddFace(lastVerts[v - 1], lastVerts[v], firstVerts[v], firstVerts[v - 1]);

          }
        }
      } else if (cap)
      {
        capm.Append(Mesh.CreateFromClosedPolyline(poly));
        mesh.Append(capm);
      }

      multimesh[pc] = mesh;
      });

    Mesh combined = new Mesh();

    foreach (var m in multimesh)
    {
      combined.Append(m);
    }

    combined.Normals.ComputeNormals();

    return combined;
  }
# ---------- end meshpipechromo ----------
preview_2 = CustomPreview(Geometry=meshpipechromo, Material=ColourSwatch(SwatchColor=RGB(230, 230, 230)))

printingsimulation_5 = Data(printingsimulation)
gcode_last_pt_2 = Point(gcode_last_pt)
home_pt = Point(Point(0, 0, 500))
filter_5 = StreamFilter(Gate=printingsimulation_5, Stream1=home_pt)
filter_6 = StreamFilter(Gate=printingsimulation_5, Stream1=gcode_last_pt_2)
Z_2 = UnitZ(Factor=Slider(1.9, range=0..10))
move_2 = Move(Geometry=filter_6, Motion=Z_2)  # -> Geometry, Transform
gcode_last_pt_3 = Point(move_2.Geometry)
null = NullItem(Item=gcode_last_pt_3)  # -> NullFlags, InvalidFlags, Description
or = GateOr(A=null.NullFlags, B=null.InvalidFlags)
filter_7 = StreamFilter(Gate=or, Stream0=gcode_last_pt_3, Stream1=filter_5)
gcode_pt = Point(filter_7)

gcode_pt_2 = Point(gcode_pt)
xy_2 = XYPlane(Origin=gcode_pt_2)
cir_2 = Circle(Plane=xy_2, Radius=expr("x*0.5", Slider(4, range=0..10)))
Z_3 = UnitZ(Factor=Slider(15, range=0..100))
offset = OffsetCurve(Curve=cir_2, Distance=Slider(0.5, range=0..1), Corners=1)
boundary_2 = BoundarySurfaces(Edges=flatten([cir_2, offset]))
Z_4 = UnitZ(Factor=Slider(26, range=0..100))
move_3 = Move(Geometry=offset, Motion=Z_4)  # -> Geometry, Transform
extr = Extrude(Base=boundary_2, Direction=Z_3)
darc = DeconstructArc(Arc=move_3.Geometry)  # -> BasePlane, Radius, Angle
move_4 = Move(Geometry=offset, Motion=Z_3)  # -> Geometry, Transform
polygon = Polygon(Plane=darc.BasePlane, Radius=Slider(12, range=0..100), Segments=6, FilletRadius=0)  # -> Polygon, Length
Z_5 = UnitZ(Factor=Slider(15, range=0..100))
merge = Merge(Data1=move_4.Geometry, Data2=polygon.Polygon)
move_5 = Move(Geometry=darc.BasePlane, Motion=Z_5)  # -> Geometry, Transform
extr_2 = Extrude(Base=polygon.Polygon, Direction=Z_5)
loft = Loft(Curves=merge, Options={Adjust=False, Closed=False, LoftEnds=0, LoftSimp=0, LoftType=0, Rebuild=10, Refit=0.01})
cutplane_extruderfixtures = Data(move_5.Geometry)
nozzle_transition = Data(loft)
nozzle_toppart = Data(extr_2)
nozzle_bot = Data(extr)

cir_3 = Circle(Plane=cutplane_extruderfixtures, Radius=Slider(30, range=0..100))
seam_2 = Seam(Curve=reparameterize(cir_3), Seam=Slider(0.25, range=0..1))
boundary_3 = BoundarySurfaces(Edges=cir_3)
extrudermount_srf = Data(boundary_3)
divide_2 = DivideCurve(Curve=seam_2, Count="3", Kinks=False)  # -> Points, Tangents, Parameters
extruder_attachmentpts = Data(divide_2.Points)

extrudermount_srf_2 = Data(extrudermount_srf)
nozzle_bot_2 = Data(nozzle_bot)
nozzle_transition_2 = Data(nozzle_transition)
nozzle_toppart_2 = Data(nozzle_toppart)
showprinter_3 = Data(showprinter)
merge_2 = Merge(Data1=nozzle_bot_2, Data2=nozzle_transition_2, Data3=nozzle_toppart_2, Data4=extrudermount_srf_2)  # -> flatten(Result)
filter_8 = StreamFilter(Gate=showprinter_3, Stream1=merge_2)
preview_3 = CustomPreview(Geometry=filter_8, Material=ColourSwatch(SwatchColor=RGB(184, 184, 184)))

wasp40100_arm_length_2 = Data(wasp40100_arm_length)
cutplane_extruderfixtures_2 = Data(cutplane_extruderfixtures)
wasp40100_z_axis_crvs_2 = Data(wasp40100_z_axis_crvs)
extruder_attachmentpts_2 = Data(extruder_attachmentpts)
plx = LinePlane(Line=wasp40100_z_axis_crvs_2, Plane=cutplane_extruderfixtures_2)  # -> Point, ParamL, ParamP
ln = Line(StartPoint=extruder_attachmentpts_2, EndPoint=plx.Point)
len_3 = Length(Curve=ln)
vec2pt = Vector2Pt(PointA=extruder_attachmentpts_2, PointB=plx.Point, Unitize=False)  # -> Vector, Length
Z_6 = UnitZ(Factor=1)
rtrig = RightTrigonometry(PLength=len_3, RLength=wasp40100_arm_length_2)  # -> Alpha, Beta, PLength, QLength, RLength
pl = ConstructPlane(Origin=extruder_attachmentpts_2, XAxis=vec2pt.Vector, YAxis=Z_6)
rotate = Rotate(Geometry=ln, Angle=rtrig.Alpha, Plane=pl)  # -> Geometry, Transform
end = EndPoints(Curve=rotate.Geometry)  # -> Start, End
wasp40100_arm_length_3 = Data(wasp40100_arm_length_2)
vec2pt_2 = Vector2Pt(PointA=end.Start, PointB=end.End, Unitize=False)  # -> unitize(Vector), Length
line_2 = LineSDL(Start=extruder_attachmentpts_2, Direction=vec2pt_2.Vector, Length=wasp40100_arm_length_3)
wasp40100_arm_crv = Data(line_2)

subsegments = Slider(10, range=0..100)
wasp40100_arm_crv_2 = Data(wasp40100_arm_crv)  # disabled
accuracy = Slider(1, range=0..1)
wasp40100_z_axis_crvs_3 = Data(wasp40100_z_axis_crvs)  # disabled
wasp40100_arm_crv_3 = Data(wasp40100_arm_crv)
capstyle = Slider(3, range=0..3)
showprinter_4 = Data(showprinter)
number_slider = Slider(2, range=0..10)  # disabled
merge_3 = Merge(Data1=wasp40100_z_axis_crvs_3, Data2=wasp40100_arm_crv_2)  # -> flatten(Result); disabled
swatch = ColourSwatch(SwatchColor=RGB(191, 191, 191))  # disabled
meshpipe = CSharpScript(Curves=wasp40100_arm_crv_3, Radius=Slider(4, range=0..10), SubSegments=subsegments, Accuracy=accuracy, CapStyle=capstyle)  # -> M; inputs Curves: list of Curve, Radius: Double, SubSegments: Int32, Accuracy: Int32, CapStyle: Int32
# ---------- meshpipe: C# usings ----------
using System.Threading.Tasks;
using System.Collections.Concurrent;
# ---------- meshpipe: C# ----------
    ConcurrentBag<Mesh> MeshPipesBag = new ConcurrentBag<Mesh>();
    MeshPipeCapStyle mpcs = (MeshPipeCapStyle) CapStyle;

    if (Curves.Count > 20)
    {
      // create pipes in parallel
      Parallel.For(0, Curves.Count,
        i => {
        // create mesh pipe
        Mesh MeshPipe = Mesh.CreateFromCurvePipe(Curves[i], Radius, SubSegments, Accuracy, mpcs, true);
        // add to tree
        MeshPipesBag.Add(MeshPipe);
        });
    }
    else
    {
      // create pipes sequential
      for (int i = 0; i < Curves.Count; i++)
      {
        // create mesh pipe
        Mesh MeshPipe = Mesh.CreateFromCurvePipe(Curves[i], Radius, SubSegments, Accuracy, mpcs, true);
        // add to tree
        MeshPipesBag.Add(MeshPipe);
      }
    }
    M = MeshPipesBag.ToArray();
# ---------- end meshpipe ----------
cpl_2 = CustomPreviewLineweights(Geometry=merge_3, Color=swatch, Thickness=number_slider)  # inputs Geometry: list, Color: list of Color; disabled; same code as cpl
filter_9 = StreamFilter(Gate=showprinter_4, Stream1=meshpipe)
preview_4 = CustomPreview(Geometry=filter_9, Material=ColourSwatch(SwatchColor=RGB(191, 191, 191)))
